# Dynamo graph genertive blocks.dyn (Dynamo 2.18.1.5096)

site_length = IntegerSlider(5000, range=5000..20000 step 1000)
site_controls_side_a = IntegerSlider(2000, range=2000..10000 step 1000)
site_controls_side_b = IntegerSlider(2000, range=2000..10000 step 1000)
site_width = IntegerSlider(2000, range=2000..10000 step 1000)
site_control_front = IntegerSlider(2000, range=2000..10000 step 1000)
site_control_rear = IntegerSlider(2000, range=2000..10000 step 1000)
site_control_garage = IntegerSlider(2000, range=2000..10000 step 1000)
code_block = CodeBlock(lw=site_length, sa=site_controls_side_a, sb=site_controls_side_b, ld=site_width, sf=site_control_front, sr=site_control_rear, gsb=site_control_garage) { hw=lw-sa-sb; hd=ld-sf-sr; lw; ld; sa; sb; sf; sr; gsb; }
code_block_2 = CodeBlock(sa=code_block.sa, sf=code_block.sf, hw=code_block.hw, hd=code_block.hd, gsb=code_block.gsb)
# ---------- code_block_2.designscript (10 lines) ----------
c1=Autodesk.Geometry.Translate(Point.Origin(),sa,sf,0);
c2=Autodesk.Geometry.Translate(c1,hw,0,0);
c3=Autodesk.Geometry.Translate(c2,0,hd,0);
c4=Autodesk.Geometry.Translate(c1,0,hd,0);
fr=Line.ByStartPointEndPoint(c1,c2);
ga=Autodesk.Geometry.Translate(fr,0,gsb,0);
gc1=Autodesk.Geometry.Translate(c1,0,gsb,0);
gc2=Autodesk.Geometry.Translate(c2,0,gsb,0);
points=[gc1,gc2,c3,c4];
bound=PolyCurve.ByPoints(points,true);
# ----------------------------------------
alferesco_width = IntegerSlider(2862, range=0..3000 step 1)
alferessco_depth = IntegerSlider(2542, range=0..3000 step 1)
code_block_3 = CodeBlock(hc4=code_block_2.c4, aw=alferesco_width, ad=alferessco_depth)
# ---------- code_block_3.designscript (7 lines) ----------
//alferesco
c1=hc4;
c2=Autodesk.Geometry.Translate(c1,aw,0,0);
c3=Autodesk.Geometry.Translate(c2,0,-ad,0);
c4=Autodesk.Geometry.Translate(c1,0,-ad,0);
points=[c1,c2,c3,c4];
bound=PolyCurve.ByPoints(points,true);
# ----------------------------------------
garage_width = IntegerSlider(3000, range=0..3000 step 1)
garage_depth = IntegerSlider(5500, range=0..5500 step 1)
coridor_width = IntegerSlider(1000, range=0..1000 step 1)
living_depth = IntegerSlider(6000, range=0..6000 step 1)
code_block_4 = CodeBlock(hc2=code_block_2.c1, gw=garage_width, gsb=code_block.gsb, gd=garage_depth, cw=coridor_width, hd=code_block.hd, lvd=living_depth)
# ---------- code_block_4.designscript (12 lines) ----------
c1=Autodesk.Geometry.Translate(hc2,-gw,gsb,0);
c2=Autodesk.Geometry.Translate(hc2,0,gsb,0);
c3=Autodesk.Geometry.Translate(c2,0,gd,0);
c4=Autodesk.Geometry.Translate(c2,-gw,gd,0);
points= [c1,c2,c3,c4];
bound=PolyCurve.ByPoints(points,true);
cc2=Autodesk.Geometry.Translate(hc2,-gw,0,0);
cc1=Autodesk.Geometry.Translate(cc2,-cw,0,0);
cc3=Autodesk.Geometry.Translate(cc2,0,hd-lvd,0);
cc4=Autodesk.Geometry.Translate(cc3,-cw,0,0);
cpoints=[cc1,cc2,cc3,cc4];
cbound=PolyCurve.ByPoints(cpoints,true);
# ----------------------------------------
md = IntegerSlider(3000, range=0..3000 step 1)
ed = IntegerSlider(2754, range=0..3000 step 1)
code_block_5 = CodeBlock(hc1=code_block_2.c1, cc1=code_block_4.cc1, md=md, ed=ed)
# ---------- code_block_5.designscript (21 lines) ----------
c1=hc1;
c2=cc1;
c3=Autodesk.Geometry.Translate(c2,0,md,0);
c4=Autodesk.Geometry.Translate(c1,0,md,0);

points= [c1,c2,c3,c4];
bound=PolyCurve.ByPoints(points,true);

//quarter width
width=Autodesk.Geometry.DistanceTo(c1,c2);
widthh=width/2;


ec2=Autodesk.Geometry.Translate(c4,widthh,0,0);
ec3=Autodesk.Geometry.Translate(ec2,0,ed,0);
ec4=Autodesk.Geometry.Translate(c4,0,ed,0);
wc3=Autodesk.Geometry.Translate(c3,0,ed,0);
pointse=[c4,ec2,ec3,ec4];
cbound=PolyCurve.ByPoints(pointse,true);
pointsw=[ec2,c3,wc3,ec3];
boundw=PolyCurve.ByPoints(pointsw,true);
# ----------------------------------------
media_included = BoolSelector(false)
media_depth = IntegerSlider(3000, range=0..3000 step 1)
bed_depth = IntegerSlider(3000, range=0..3000 step 1)
if_ = RefactoredIf(test=media_included, true=media_depth, false=bed_depth)
bedroom_and_media = CodeBlock(gc4=code_block_4.c4, gc3=code_block_4.c3, md=if_, bd=bed_depth)
# ---------- bedroom_and_media.designscript (17 lines) ----------
c1=gc4;
c2=gc3;
c3=Autodesk.Geometry.Translate(c2,0,md,0);
c4=Autodesk.Geometry.Translate(c1,0,md,0);

points= [c1,c2,c3,c4];
bound=PolyCurve.ByPoints(points,true);

//boundry block 2,3
b1c3=Autodesk.Geometry.Translate(c3,0,bd,0);
b1c4=Autodesk.Geometry.Translate(c4,0,bd,0);
b2c3=Autodesk.Geometry.Translate(b1c3,0,bd,0);
b2c4=Autodesk.Geometry.Translate(b1c4,0,bd,0);
pointsb1=[c4,c3,b1c3,b1c4];
boundb1=PolyCurve.ByPoints(pointsb1,true);
pointsb2=[b1c4,b1c3,b2c3,b2c4];
boundb2=PolyCurve.ByPoints(pointsb2,true);
# ----------------------------------------
alfresco_included = BoolSelector(true)
