# Dynamo graph structural.dyn (Dynamo 2.18.1.5096)
# packages: Structural Design 2023.10.10

width = IntegerSlider(2050, range=1000..5000 step 50)
height = IntegerSlider(800, range=200..1000 step 100)
angle = IntegerSlider(20, range=0..45 step 5)
byWidthHeightAngles = StructuralDesign.Model.Frame.ByWidthHeightAngles(width=width, height=height, angle=angle)
number_of_spans = IntegerSlider(10, range=0..45 step 5)
length = CodeBlock(number_span=number_of_spans) { length=5000; span=length/number_span; }
copy = StructuralDesign.Model.Frame.Copy(frame2DGeometry=byWidthHeightAngles.2DFrame, numberOfTimes=number_of_spans, spacing=length.span)
purlins = StructuralDesign.Model.Frame.Purlins(rafters=copy.Beams)
code_block = CodeBlock(bay=number_of_spans) { 1..bay..2; }
XBracings = StructuralDesign.Model.Frame.XBracings(points=purlins.Points, zones=code_block)
code_block_2 = CodeBlock(heigth=height) { a=[heigth/3,heigth/(3/2)]; }
sideRailsEavesBeams = StructuralDesign.Model.Frame.SideRailsEavesBeams(columns=copy.Columns, heights=code_block_2)
levels = Levels("Level 0")
structural_framing_types = StructuralFramingTypes("UB305x165x40")
beamByCurve = StructuralFraming.BeamByCurve(curve=copy.Beams, level=levels, structuralFramingType=structural_framing_types)
